% Simulink data dictionary batman_dictionary.sldd

Data_ControllerOutputs = Simulink.Bus()
  Voltage: double, Unit="V"  % Voltage to drive the system.

Physical_SystemStates = Simulink.ConnectionBus()
  Cart: Connection: foundation.mechanical.translational.translational  % Physical mechanical signals to extract info regarding the motion of the cart.
  Pendulum: Connection: foundation.mechanical.rotational.rotational

Data_Sensors = Simulink.Bus()
  Cart_Position: double, Unit="m"
  Cart_Velocity: double, Unit="m/s"
  Pendulum_Position: double, Unit="deg"
  Pendulum_Velocity: double, Unit="deg/s"

Data_ControllerInputs = Simulink.Bus()
  Trigger: boolean  % This trigger enables the start/stop of the controller.
    % The controller detects rising and falling edges and operates accordingly.

Physical_Environment = Simulink.ConnectionBus()
  World: Connection: simmechanics.connections.frame

Variants = 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